# Grasshopper definition ET_grasshopper.gh (Grasshopper 1.0.8)
# plug-ins: EasyTransfer.Components

list = ValueList({"Mesh", "Curve", "PointCloud"}, selected="PointCloud")
toggle = BooleanToggle(True)
path = FilePath("/Users/taomou/Desktop/_temp.usda")
import_usd = Python3Script(Run=toggle, Path=path, Filter=list)  # -> Geometry, Key, Domain, ValueWrap; inputs Run: Boolean, Path: String, Filter: String
#   port Path: USD file path
#   port Filter: Geometry type filter
#   port Geometry: Geometry in USd file
#   port Key: Geometry attributes name
#   port Domain: Geometry attributes domain
#   port ValueWrap: Geometry attributes value, import as list
# ---------- import_usd: Python ----------
import os
import sys
import System
import importlib
import Grasshopper
from System.Collections import IList
from Grasshopper.Kernel.Data import GH_Path
from library import ET_rhino

def importusd(Run, Path, Filter):
    if not Filter:
        Filter = "Mesh"
        
    if not Run or not Path or not os.path.exists(Path):
        return None, None, None, None
        
    net_geometry, net_keys, net_domains, net_values = ET_rhino.GH.Import(Path, Filter)
    
    keys_tree = Grasshopper.DataTree[System.String]()
    domains_tree = Grasshopper.DataTree[System.String]()
    values_tree = Grasshopper.DataTree[IList]()
    
    for kvp in net_keys:
        gIdx, kList = kvp.Key, kvp.Value
        keys_tree.AddRange(kList, GH_Path(gIdx))
        
    for kvp in net_domains:
        gIdx, dList = kvp.Key, kvp.Value
        domains_tree.AddRange(dList, GH_Path(gIdx))
        
    for g_kvp in net_values:
        gIdx = g_kvp.Key
        attr_list = g_kvp.Value
        for vList in attr_list:
            values_tree.Add(vList, GH_Path(gIdx))
            
    return net_geometry, keys_tree, domains_tree, values_tree

_run_val = Run if "Run" in globals() else False
_path_val = Path if "Path" in globals() else None
_filter_val = Filter if "Filter" in globals() else None

Geometry, Key, Domain, ValueWrap = importusd(_run_val, _path_val, _filter_val)
# ---------- end import_usd ----------
panel = Panel("/Users/taomou/Desktop/_temp0.usda")
importusd = ImportUSD(Run=toggle, Path=path, Filter=list)  # -> Geometry, Key, Domain, ValueWrap
button = Button()
unwrap = Python3Script(Wrap=import_usd.ValueWrap)  # -> Value; inputs Wrap: tree
#   port Wrap: Attribute value list
#   port Value: Attribute value
# ---------- unwrap: Python ----------
import System
import Grasshopper
from Grasshopper.Kernel.Data import GH_Path
from System.Collections import IList
from library import ET_rhino

# if Wrap is not None:
#     Value = list(Wrap)
# else:
#     Value = None

out_tree = Grasshopper.DataTree[System.Object]()
if Wrap is not None:
    for path in Wrap.Paths:
        v_list = Wrap.Branch(path)
        
        for i, v in enumerate(v_list):
            out_path = path.AppendElement(i)
            py_list = list(v)
            
            out_tree.AddRange(py_list, out_path)
                
    Value = out_tree
else:
    Value = None
# ---------- end unwrap ----------
unwrap_2 = Unwrap(Wrap=importusd.ValueWrap)
geo = Geometry(import_usd.Geometry)
wrap = Python3Script(Value=unwrap)  # -> Wrap; inputs Value: tree
#   port Value: Attribute value
#   port Wrap: Attribute value list
# ---------- wrap: Python ----------
import System
import Grasshopper
from System.Collections import IList
from library import ET_rhino

out_tree = Grasshopper.DataTree[IList]()

if Value is not None:
    for path in Value.Paths:
        v_list = Value.Branch(path)
        net_list = ET_rhino.Utility.Wrap(v_list)
        out_tree.Add(net_list, path)
        Wrap = out_tree
else:
    Wrap = None
# ---------- end wrap ----------
wrap_2 = Wrap(Value=unwrap_2)
export_usd = Python3Script(
    Run=button,
    Path=panel,
    Geometry=geo,
    Key=simplify(import_usd.Key),
    Domain=simplify(import_usd.Domain),
    ValueWrap=simplify(wrap))  # -> Message; inputs Run: Boolean, Path: String, Geometry: list of GeometryBase, Key: tree of String, Domain: tree of String, ValueWrap: tree
# ---------- export_usd: Python ----------
import os
import sys
import importlib
import Rhino
import System.Drawing
import Eto.Forms
import scriptcontext as sc
from Grasshopper.Kernel.Data import GH_Path
from library import ET_rhino

if "PERSISTENT_MSG" not in globals():
    PERSISTENT_MSG = "Waiting to execute export..."

def exportusd(Run, Path, valid_geo_input, Key, Domain, Value):
    global PERSISTENT_MSG
    if not Run or not Path:
        return PERSISTENT_MSG

    py_geometry = []
    for g in valid_geo_input:
        if "Guid" in str(type(g)):
            rh_obj = Rhino.RhinoDoc.ActiveDoc.Objects.FindId(g)
            if rh_obj: py_geometry.append(rh_obj.Geometry)
        else:
            py_geometry.append(g)
            
    py_names = []
    py_keys = {}
    py_domains = {}
    py_values = {}
    
    for gIdx in range(len(py_geometry)):
        path = GH_Path(gIdx)
        
        if Key and Key.PathExists(path):
            k_list = [str(k) for k in Key.Branch(path)]
        else:
            k_list = []
        py_keys[gIdx] = k_list
            
        if Domain and Domain.PathExists(path):
            d_list = [str(d) for d in Domain.Branch(path)]
        else:
            d_list = []
        py_domains[gIdx] = d_list
            
        v_list = []
        if Value and Value.PathExists(path):
            raw_items = Value.Branch(path)
            for item in raw_items:
                val = getattr(item, "Value", item)
                try:
                    v_list.append(list(val))
                except TypeError:
                    v_list.append([val])
        py_values[gIdx] = v_list

        if not (len(k_list) == len(d_list) == len(v_list)):
            PERSISTENT_MSG = f"Error: Attribute count mismatch at geometry {gIdx}. Keys: {len(k_list)}, Domains: {len(d_list)}, Values: {len(v_list)}."
            return PERSISTENT_MSG
            
    try:
        ET_rhino.GH.Export(Path, py_geometry, py_names, py_keys, py_domains, py_values)
        Eto.Forms.Clipboard.Instance.Text = Path
        PERSISTENT_MSG = f"Successfully exported to {Path}"
        return PERSISTENT_MSG
    except Exception as e:
        PERSISTENT_MSG = f"Export failed: {e}" 
        return PERSISTENT_MSG

class DashedBBoxPreview:
    def __init__(self, comp, box):
        self.comp = comp
        self.box = box
        
    def Draw(self, sender, e):
        try:
            if self.comp is None or self.comp.OnPingDocument() is None:
                Rhino.Display.DisplayPipeline.DrawOverlay -= self.Draw
                return
                
            if getattr(self.comp.Attributes, "Selected", False) and not getattr(self.comp, "Hidden", False):
                color = System.Drawing.Color.FromArgb(235,0,138)
                
                edges = self.box.GetEdges()
                if edges:
                    for edge in edges:
                        e.Display.DrawPatternedLine(edge.From, edge.To, color, 0x00000F0F, 2)
                        
                if hasattr(e.Display, "DrawBoxCorners"):
                    e.Display.DrawBoxCorners(self.box, color, 1, 4)
        except Exception:
            Rhino.Display.DisplayPipeline.DrawOverlay -= self.Draw

valid_geo_input = []
if Geometry is not None:
    try:
        iter(Geometry)
        valid_geo_input = list(Geometry)
    except TypeError:
        valid_geo_input = [Geometry]

valid_geo_input = [g for g in valid_geo_input if g]

sticky_key = f"usd_export_bbox_{ghenv.Component.InstanceGuid}"
if sticky_key in sc.sticky:
    try:
        old_handler = sc.sticky[sticky_key]
        Rhino.Display.DisplayPipeline.DrawOverlay -= old_handler.Draw
    except Exception:
        pass
    del sc.sticky[sticky_key]

if not valid_geo_input:
    Message = "Warning: Input Geometry is empty."
else:
    bbox = Rhino.Geometry.BoundingBox.Empty
    for g in valid_geo_input:
        b = g.GetBoundingBox(True)
        if b.IsValid:
            bbox.Union(b)
            
    if bbox.IsValid:
        PREVIEW_BBOX_HANDLER = DashedBBoxPreview(ghenv.Component, bbox)
        Rhino.Display.DisplayPipeline.DrawOverlay += PREVIEW_BBOX_HANDLER.Draw
        sc.sticky[sticky_key] = PREVIEW_BBOX_HANDLER

    Message = exportusd(Run, Path, valid_geo_input, Key, Domain, ValueWrap)
# ---------- end export_usd ----------
trim = TrimTree(Tree=wrap_2, Depth=1)
export_usd_2 = ExportUSD(Run=button, Path=panel, Geometry=importusd.Geometry, Key=importusd.Key, Domain=importusd.Domain, ValueWrap=trim)
panel_2 = Panel(export_usd_2)
